# Requirement set sys-reqs (R2024a)

## 1 [#1] COM (Container)
вимоги до комунікації

### 1.1 [#3] Com.components
програмна композиція повинна налічувати компонент комунікації з апаратним успадкуванням

### 1.2 [#5] IO structure
прграмна композиція повинна забезпечувати комунікацію з апаратним успадкуванням у двосторонньому порядку.
Вона повинна мати змогу передавати на апаратне забезпечення велечину заповниності ШІМ (у проміжку від 0 до 100 включаючи крайні значення) з точністю до 1% у від діапазону
Також вона повинна зчитувати значення кута та кутової швидкості двигуна з точністю не нижче 0.01 градуса та 0.01 с відповідно

## 2 [#2] SREAD
Компонент Scanner Read повинен зчитувати значення кутової швидкості з апаратного забезпечення через комунікаційний компонент і перетворювати його у формат, придатний для читання компонентом двигуна.
Keywords: mt

### 2.1 [#9] MCON

#### 2.1.1 [#10] Motor control-out
програмна композиція повинна містити засоби управління двигуном по напрямку та швидкості.
напрямлк визначається двома можливими значеннями: (Ліво ,право)
за велечинами 0 та 1 відповідно.
Зупинка двигуна заюезпечується швидкістю.
Швидкість двигуна передається на апаратне успадкування у якості заповнення скважності ШІМ у ріадазоні 0 - 100 включаючи крайні значення. Точність не повинна бути меншою за 0.01% загального діапазона значення

## 3 [#7] CON
Цей компонент є інтегратором керування, куди входить перехідний формат. Цей компонент порівнює бажане значення з фактичним значенням і адресує його компоненту двигуна.

## 4 [#8] HMI
Людино-машинний інтерфейс повинен забезпечувати зв’язок у режимі реального часу між simulink, апаратним забезпеченням і людиною. Його можна підключити до джойстика або мобільного телефону для керування системою.